# Dynamo graph 04_Copy-Place_CA-Legend.dyn (Dynamo 2.16.2.5624)

# group: Copy "DSP Comp Ref" to Current Project and Place on Sheet
file_path = Filename("Templates\ACI_Project_Template.rte")
code_block = CodeBlock { "DSP Comp Ref"; }
code_block_2 = CodeBlock { "FIXTURE PLAN"; }
code_block_3 = CodeBlock { [3.483, 2.695, 0.0]; }
copy_and_place_legend = Python(IN[0]=file_path, IN[1]=code_block, IN[2]=code_block_2, IN[3]=code_block_3)  # CPython3
# ---------- copy_and_place_legend.python (113 lines) ----------
import clr
clr.AddReference('RevitAPI')
clr.AddReference('RevitServices')
clr.AddReference('System')

from System import Guid
from System.Collections.Generic import List
from Autodesk.Revit.DB import *
from RevitServices.Persistence import DocumentManager
from RevitServices.Transactions import TransactionManager

# Get the current Revit document (the active project)
doc = DocumentManager.Instance.CurrentDBDocument

# Inputs from Dynamo
template_path = IN[0]  # File path to the Revit template (RVT) file
legend_name = IN[1]  # Name of the Legend View to extract
sheet_name = IN[2]   # Name of the sheet to place the legend on
placement_location = IN[3]  # XYZ coordinates for the placement of the legend (tuple/list)

copied_legend_id = None
legend_on_sheet_id = None

debug_info = []  # Using a list to make further processing in Dynamo easier

debug_info.append("Step: Initialization")

try:
    # Start a transaction to remove any existing legend with the same name
    TransactionManager.Instance.EnsureInTransaction(doc)
    existing_legend = next((view for view in FilteredElementCollector(doc).OfClass(View)
                            if view.ViewType == ViewType.Legend and view.Name == legend_name), None)

    if existing_legend:
        doc.Delete(existing_legend.Id)
    TransactionManager.Instance.TransactionTaskDone()
    debug_info.append("Step: Removed existing legend (if any)")

    # Open the Revit template document
    app = doc.Application
    template_doc = app.OpenDocumentFile(template_path)
    debug_info.append("Step: Template document opened")

    try:
        # Find the legend view by name in the template file
        legend_view = next((view for view in FilteredElementCollector(template_doc).OfClass(View)
                            if view.ViewType == ViewType.Legend and view.Name == legend_name), None)

        if legend_view is None:
            OUT = f"Error: Legend view named '{legend_name}' not found in the template."
        else:
            # Start a transaction to copy the legend into the current document
            TransactionManager.Instance.EnsureInTransaction(doc)

            # Copy the legend to the current project
            element_ids = List[ElementId]([legend_view.Id])
            copied_ids = ElementTransformUtils.CopyElements(template_doc, element_ids, doc, Transform.Identity, CopyPasteOptions())

            TransactionManager.Instance.TransactionTaskDone()

            # Get the copied legend
            copied_legend_id = copied_ids[0]
            copied_legend = doc.GetElement(copied_legend_id)
            debug_info.append("Step: Copied legend into the current project")
            debug_info.append(f"Copied Legend ID: {copied_legend_id.IntegerValue}")
    finally:
        # Ensure the template document is closed properly
        if template_doc.IsValidObject:
            template_doc.Close(False)
        debug_info.append("Step: Template document closed")

    # Locate the sheet where the legend should be placed
    sheet = next((s for s in FilteredElementCollector(doc).OfClass(ViewSheet) if s.Name == sheet_name), None)

    if sheet is None:
        OUT = f"Error: Sheet named '{sheet_name}' not found in the current project."
    else:
        # Start a transaction to either place or move the legend on the sheet
        TransactionManager.Instance.EnsureInTransaction(doc)
        debug_info.append("Step: Transaction started for placing legend")

        # Convert placement_location to XYZ
        x, y, z = placement_location
        position = XYZ(x, y, z)

        try:
            # Place the legend view on the sheet using Viewport.Create
            viewport = Viewport.Create(doc, sheet.Id, copied_legend.Id, position)

            if viewport is None:
                OUT = f"Error: Could not place the legend '{legend_name}' on sheet '{sheet_name}'."
            else:
                legend_on_sheet_id = viewport.Id

                # Simple output for viewport creation success
                debug_info.append(f"Viewport Element ID: {legend_on_sheet_id.IntegerValue}")
                debug_info.append("Step: Viewport successfully created")

                OUT = debug_info
        except Exception as e:
            TransactionManager.Instance.ForceCloseTransaction()
            debug_info.append(f"Step: Error during viewport placement: {e}")
            OUT = f"Error during placement: {e}"

        TransactionManager.Instance.TransactionTaskDone()
        debug_info.append("Step: Transaction completed for placing legend")

except Exception as e:
    debug_info.append(f"Step: Error: {e}")
    OUT = f"Error: {e}"

# Output only the relevant result, including debug information
OUT = OUT
# ----------------------------------------
